# Grasshopper definition EUI_Computer.gh (Grasshopper 1.0.7)
# plug-ins: ClimateStudioGH

panel = Panel("""{ "shading": { "s": 0, "n": 0, "e": 0, "w": 0 },
  "wwr": { "s": 0.5, "n": 0.5, "e": 0.5, "w": 0.5 },
  "glazing": { "assembly": 0 },
  "envelope": { "walls": 0, "roofs": 0, "floors": 0, "tightness": 0 },
  "lighting": { "dimming": 0, "type": 0 },
  "hvac": { "hrv": 0, "source": 0, "fans": 0 }
}""")
geo = Geometry([<brep referenced from the Rhino model> x3])
k2ls = Kangaroo2LiveSolver(geometry=geo, run=Toggle(False), buildingParameters=panel)  # -> out, baselineResults, efficacies, labels, euis, costs; inputs geometry: list of Brep, run: Boolean
# ---------- k2ls: Python ----------
__author__ = "Sam Wolk"
__version__ = "2022.03.23"

ghenv.Component.Name = "Kangaroo2LiveSolver"
ghenv.Component.NickName ="K2LS"
        
import rhinoscriptsyntax as rs
import Grasshopper as gh
import json
import random
import time

def updateComponent():
    """ Updates this component, similar to using a grasshopper timer """
    
    # Define callback action
    def callBack(e):
        ghenv.Component.ExpireSolution(False)
        
        
    # Get grasshopper document
    ghDoc = ghenv.Component.OnPingDocument()
    
    # Schedule this component to expire
    ghDoc.ScheduleSolution(2000,gh.Kernel.GH_Document.GH_ScheduleDelegate(callBack))

def computeSim(geometry,parameters):
    print("start sim")
    cluster = gh.Kernel.Special.GH_Cluster()
    cluster.CreateFromFilePath("C:\Users\Sam Wolk\Dropbox\mit\design-optimization\EUI_Computer_Cluster.ghcluster")
    for i in range(len(geometry)):
        cluster.Params.Input[0].AddVolatileData(gh.Kernel.Data.GH_Path(0), i,geometry[i])
    cluster.Params.Input[1].AddVolatileData(gh.Kernel.Data.GH_Path(0), 0, parameters)
    doc = gh.Kernel.GH_Document()
    print("quarter sim")
    doc.Enabled = True
    print("split")
    doc.AddObject(cluster, True, 0)
    print("three eighths sim")
    structure = cluster.Params.Output[0].VolatileData
    tree = gh.DataTree[object]()
    print("mid sim")
    tree.MergeStructure(structure, gh.Kernel.Parameters.Hints.GH_NullHint())
    cost = tree.Branch(0)[0].Value
    structure = cluster.Params.Output[2].VolatileData
    tree = gh.DataTree[object]()
    tree.MergeStructure(structure, gh.Kernel.Parameters.Hints.GH_NullHint())
    eui = tree.Branch(0)[0].Value
    doc.Enabled = False
    doc.RemoveObject(cluster, False)
    doc.Dispose()
    doc = None
    print("end sim")
    return eui,cost


parameterMetadata = {
    'envelope' : {
        'roofs' : {'min':0,'max':2,'steps':3},
        'floors' : {'min':0,'max':1,'steps':2},
        'tightness':{'min':0,'max':1,'steps':2},
        'walls':{'min':0,'max':3,'steps':4}
    },
    'hvac':{
        'source':{'min':0,'max':2,'steps':3},
        'hrv':{'min':0,'max':1,'steps':2},
        'fans':{'min':0,'max':1,'steps':2}
    },
    'lighting':{
        'dimming':{'min':0,'max':1,'steps':2},
        'type':{'min':0,'max':1,'steps':2}
    },
    'wwr':{
    's':{'min':0,'max':1,'steps':20},
        'e':{'min':0,'max':1,'steps':20},
        'w':{'min':0,'max':1,'steps':20},
        'n':{'min':0,'max':1,'steps':20}
    },
}

if 'baseline' not in globals() and run:
    start = time.time()
    eui,cost = computeSim(geometry, buildingParameters)
    duration = time.time() - start
    baseline = {'eui':eui, 'cost':cost, 'duration':duration}
    baselineResults = json.dumps(baseline)
    
if 'results' not in globals():
    results = []
    
if 'firstOrderParametersToTest' not in globals():
    firstOrderParametersToTest = []
    for (category,parameters) in parameterMetadata.items():
        for (parameter,data) in parameters.items():
            key = category+"-"+parameter
            value = data['max']
            keyVal = {'key':key,'value':value}
            firstOrderParametersToTest.append(keyVal)
    random.shuffle(firstOrderParametersToTest)

testParameters = json.loads(buildingParameters)

if len(firstOrderParametersToTest) > 0 and run:
    parameterToTest = firstOrderParametersToTest.pop(0)
    category = parameterToTest['key'].split("-")[0]
    param = parameterToTest['key'].split("-")[1]
    testParameters[category][param] = parameterToTest['value']
    start = time.time()
    eui,cost = computeSim(geometry,json.dumps(testParameters))
    duration = time.time() - start
    result = {}
    result['key'] = parameterToTest['key']
    result['value'] = parameterToTest['value']
    result['eui'] = eui
    result['cost'] = cost
    result['duration'] = duration
    result['euiDelta'] = eui-baseline['eui']
    result['costDelta'] = cost-baseline['cost']
    result['durationDelta'] = duration - baseline['duration']
    result['efficacy'] = result['euiDelta'] / (result['costDelta'] if result['costDelta'] != 0 else 1)
    results.append(result)

out = json.dumps(results)
results.sort(key = lambda res : res['efficacy'])


    
efficacies = [result['efficacy'] for result in results]
labels = [result['key'] for result in results]
euis = [result['eui'] for result in results]
costs = [result['cost'] for result in results]

if run:
    updateComponent()
# ---------- end k2ls ----------
dam = DataDam(DataA=k2ls.efficacies, DataB=k2ls.labels, DataC=k2ls.euis, DataD=k2ls.costs, BufferDelay=10000000, BufferMode=2)  # -> DataA, DataB, DataC, DataD
split = TextSplit(Text=dam.DataB, Separators="-")
plotter = CSPlotter(
    Type=3,
    Width=550,
    Height=450,
    X_title="EUI",
    Y_title="Cost",
    X_data=dam.DataD,
    X_rot=0,
    Y_data=dam.DataC,
    Range="200 to 250",
    Show_xgrid=False,
    Show_ygrid=invert(True),
    Legend=0,
    PreviewDimension=1,
    InfinateZoomDisplay=True,
    UnitSystem=4)
item = ListItem(List=split, Index=0, Wrap=True)  # -> Item, flatten(Item1)
plotter_2 = CSPlotter(
    Type=1,
    Width="1000",
    Height="1000",
    Y_title="dEUI/dCost",
    X_labels=item.Item1,
    X_rot=0,
    Y_data=dam.DataA,
    Grid_x=1,
    Show_xgrid=invert(False),
    Show_ygrid=invert(True),
    Legend=3,
    PreviewDimension=1,
    InfinateZoomDisplay=True,
    UnitSystem=4)
